# Grasshopper definition flask_server.gh (Grasshopper 1.0.7)
# plug-ins: Hops, Human

panel = Panel("C:\Users\Andrea\Desktop\thesis_server\id_use")
panel_2 = Panel("D:\patches_all_split\part2\T01922L")
panel_3 = Panel("D:\patches_all_split\part1\T00004E")
mesh = Mesh()
curve = Curve(<curve referenced from the Rhino model>)
point = Point([<point referenced from the Rhino model> x3])
ghpython_script = GhPythonScript(folder=panel)  # -> out, buildings, trees, extent, landuse, roads, buildings_uncropped
# ---------- ghpython_script: Python ----------
import os

# Make sure this variable is an input to the script
# Example: input parameter in GhPython called `folder`
# folder = "C:\\Users\\YourName\\Documents\\MyGeoData"

# Initialize output variables
buildings = None
trees = None
extent = None
landuse = None
roads = None
buildings_uncropped = None

# Expected filenames
files = {
    "buildings": "buildings.geojson",
    "trees": "trees.geojson",
    "extent": "window.geojson",
    "landuse": "landuse.geojson",
    "roads": "roads.geojson",
    "buildings_uncropped": "buildings_uncropped.geojson"    
}

# Assign full paths if files exist
if folder and os.path.isdir(folder):
    b = os.path.join(folder, files["buildings"])
    t = os.path.join(folder, files["trees"])
    w = os.path.join(folder, files["extent"])
    l = os.path.join(folder, files["landuse"])
    r = os.path.join(folder, files["roads"])
    u = os.path.join(folder, files["buildings_uncropped"])

    buildings = b if os.path.isfile(b) else None
    trees = t if os.path.isfile(t) else None
    extent = w if os.path.isfile(w) else None
    landuse = l if os.path.isfile(l) else None
    roads = r if os.path.isfile(r) else None
    buildings_uncropped = u if os.path.isfile(u) else None
else:
    print("❌ Invalid folder path")
# ---------- end ghpython_script ----------
panel_4 = Panel("""10
15""")
ghpython_script_2 = GhPythonScript(root_folder="C:\Users\Andrea\Desktop\thesis2\patches_new", partial_name="T12175J")  # -> out, selected_folder
# ---------- ghpython_script_2: Python ----------
import os

selected_folder = None  # Output

if root_folder and os.path.isdir(root_folder):
    # Get subfolders (only directories)
    subfolders = [f for f in os.listdir(root_folder)
                  if os.path.isdir(os.path.join(root_folder, f))]
    
    # Search for first folder that contains the partial_name (case-insensitive)
    for folder in subfolders:
        if partial_name.lower() in folder.lower():
            selected_folder = os.path.join(root_folder, folder)
            break
    
    if not selected_folder:
        selected_folder = "No matching folder found."
else:
    selected_folder = "Invalid folder path."
# ---------- end ghpython_script_2 ----------
ghpython_script_3 = GhPythonScript(root_folder="D:\selected_folders", index=Slider(0, range=0..9))  # -> out, selected_folder; inputs index: Int32
# ---------- ghpython_script_3: Python ----------
import os

selected_folder = None

if root_folder and os.path.isdir(root_folder):
    # Get only subdirectories, sorted alphabetically
    subfolders = [f for f in os.listdir(root_folder) 
                  if os.path.isdir(os.path.join(root_folder, f))]
    subfolders.sort()

    # Clamp the index to valid range
    if subfolders:
        clamped_index = max(0, min(index, len(subfolders) - 1))
        selected_folder = os.path.join(root_folder, subfolders[clamped_index])
    else:
        selected_folder = "No subfolders found."
else:
    selected_folder = "Invalid folder path."
# ---------- end ghpython_script_3 ----------
ghpython_script_4 = GhPythonScript(points=point, heights=panel_4, radii="4")  # -> out, flatten(a); inputs points: list of Point3d, heights: list, radii: list
# ---------- ghpython_script_4: Python ----------
import json
import Rhino.Geometry as rg

# Build GeoJSON FeatureCollection
features = []
for pt, h, r in zip(points, heights, radii):
    feature = {
        "type": "Feature",
        "geometry": {
            "type": "Point",
            "coordinates": [pt.X, pt.Y]  # base of tree
        },
        "properties": {
            "height": float(h),
            "radius": float(r),
            "type": "tree"
        }
    }
    features.append(feature)

geojson = {
    "type": "FeatureCollection",
    "features": features
}

a = json.dumps(geojson, indent=2)
# ---------- end ghpython_script_4 ----------
ladybug = Ladybug_Ladybug()  # -> Vviiiiiiiiiizzz; plug-in component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
division = Division(A=panel_4, B="3")
unit_z = UnitZ(Factor=division)
ghpython_script_5 = GhPythonScript(geojson_path=ghpython_script.buildings)  # -> out, geo_out, keys_out, values_out
# ---------- ghpython_script_5: Python ----------
import json
import Rhino.Geometry as rg
import Grasshopper
from Grasshopper import DataTree
from Grasshopper.Kernel.Data import GH_Path

def parse_geometry(geom):
    gtype = geom["type"]
    coords = geom["coordinates"]

    if gtype == "Point":
        return rg.Point3d(coords[0], coords[1], 0.0)

    elif gtype == "LineString":
        pts = [rg.Point3d(x, y, 0.0) for x, y in coords]
        return rg.PolylineCurve(pts)

    elif gtype == "Polygon":
        rings = []
        for ring in coords:
            pts = [rg.Point3d(x, y, 0.0) for x, y in ring]
            if pts[0] != pts[-1]:
                pts.append(pts[0])  # ensure closed
            rings.append(rg.PolylineCurve(pts))
        return rings[0] if rings else None

    elif gtype == "MultiPolygon":
        polys = []
        for poly in coords:
            outer = poly[0]
            pts = [rg.Point3d(x, y, 0.0) for x, y in outer]
            if pts[0] != pts[-1]:
                pts.append(pts[0])
            polys.append(rg.PolylineCurve(pts))
        return polys

    elif gtype == "MultiLineString":
        lines = []
        for line in coords:
            pts = [rg.Point3d(x, y, 0.0) for x, y in line]
            lines.append(rg.PolylineCurve(pts))
        return lines

    return None


# --- MAIN ---
geo_out = []
keys_out = []
values_out = DataTree[object]()

with open(geojson_path, "r") as f:
    data = json.load(f)

features = data.get("features", [])
if features:
    # property keys from the first feature
    keys_out = list(features[0].get("properties", {}).keys())

    for i, feat in enumerate(features):
        geom = feat.get("geometry")
        props = feat.get("properties", {})

        # geometry
        rhino_geom = parse_geometry(geom)
        if rhino_geom:
            if isinstance(rhino_geom, list):
                geo_out.extend(rhino_geom)
            else:
                geo_out.append(rhino_geom)

        # add properties to DataTree branch
        path = GH_Path(i)
        for k in keys_out:
            values_out.Add(props.get(k, None), path)
# ---------- end ghpython_script_5 ----------
ghpython_script_6 = GhPythonScript(filepath=ghpython_script.trees)  # -> out, points, heights, radii
# ---------- ghpython_script_6: Python ----------
import json
import Rhino.Geometry as rg

# Outputs
points = []
heights = []
radii = []

# Load GeoJSON
if filepath and filepath.endswith(".geojson"):
    with open(filepath, 'r') as f:
        data = json.load(f)

    features = data.get("features", [])

    for feature in features:
        geometry = feature.get("geometry", {})
        props = feature.get("properties", {})

        if geometry.get("type") == "Point":
            coords = geometry.get("coordinates", [])
            if len(coords) >= 2:
                x, y = coords[:2]
                z = coords[2] if len(coords) > 2 else 0.0

                # Rhino Point3d
                pt = rg.Point3d(x, y, z)
                points.append(pt)

                # Height from properties, minimum 10
                try:
                    height = float(props.get("height", 0.0))
                except:
                    height = 0.0
                height = max(height, 10.0)  # enforce minimum of 10
                heights.append(height)

                # radius (fixed value)
                radii.append(4.0)
# ---------- end ghpython_script_6 ----------
ghpython_script_7 = GhPythonScript(geojson_path=ghpython_script.extent)  # -> out, geo_out, keys_out, values_out; same code as ghpython_script_5
ghpython_script_8 = GhPythonScript(geojson_path=ghpython_script.extent)  # -> out, geo_out, keys_out, values_out; same code as ghpython_script_5
ghpython_script_9 = GhPythonScript(geojson_path=ghpython_script.landuse)  # -> out, geo_out, keys_out, values_out; same code as ghpython_script_5
ghpython_script_10 = GhPythonScript(geojson_path=ghpython_script.buildings_uncropped)  # -> out, geo_out, keys_out, values_out; same code as ghpython_script_5
subtraction = Subtraction(A=panel_4, B=division)
number_slider = Slider(2, range=0..10)
panel_5 = Panel("https://climate.onebuilding.org/WMO_Region_6_Europe/ESP_Spain/CT_Catalonia/ESP_CT_Barcelona.081800_TMYx.zip")
division_2 = Division(A=ghpython_script_6.heights, B="3")
polygon = Polygon(Plane=point, Radius=".25", Segments="8", FilletRadius=0)  # -> Polygon, Length
custom_preview_lineweights = CustomPreviewLineweights(
    Geometry=ghpython_script_5.geo_out,
    Shader=ColourSwatch(SwatchColor=RGB(84, 84, 84)),
    Thickness=Slider(2, range=0..10),
    Absolute=False)
polygon_2 = Polygon(Plane=point, Radius="4", Segments="8", FilletRadius=0)  # -> Polygon, Length
polygon_3 = Polygon(Plane=ghpython_script_6.points, Radius=".25", Segments="8", FilletRadius=0)  # -> Polygon, Length
polygon_4 = Polygon(Plane=ghpython_script_6.points, Radius="4", Segments="8", FilletRadius=0)  # -> Polygon, Length
unit_z_2 = UnitZ(Factor=division_2)
merge = Merge(Data1=unit_z_2)  # -> flatten(Result)
subtraction_2 = Subtraction(A=ghpython_script_6.heights, B=division_2)
ghpython_script_11 = GhPythonScript()  # -> out, tmrt_image
# ---------- ghpython_script_11: Python ----------
import os

# Input: folder path (e.g., from Grasshopper or Python input)
# Example: folder = r"C:\Users\Andrea\Desktop\your_folder"
tmrt_image = None

if folder and os.path.isdir(folder):
    image_path = os.path.join(folder, "Tmrt_average.png")
    if os.path.isfile(image_path):
        tmrt_image = image_path
else:
    print("❌ Invalid folder path")
# ---------- end ghpython_script_11 ----------
key_value_search = KeyValueSearch(Keys=ghpython_script_5.keys_out, Values=ghpython_script_5.values_out, Search="height")  # -> flatten(Result)
unit_z_3 = UnitZ(Factor=key_value_search)
key_value_search_2 = KeyValueSearch(Keys=ghpython_script_9.keys_out, Values=ghpython_script_9.values_out, Search="Usos")  # -> flatten(Result)
move = Move(Geometry=polygon_4.Polygon, Motion=merge)  # -> Geometry, Transform
unit_z_4 = UnitZ(Factor=subtraction_2)
ghpython_script_12 = GhPythonScript(points=ghpython_script_6.points, heights=ghpython_script_6.heights, radii=ghpython_script_6.radii)  # -> out, flatten(a); inputs points: list of Point3d, heights: list, radii: list; same code as ghpython_script_4
move_2 = Move(Geometry=polygon_2.Polygon, Motion=unit_z)  # -> Geometry, Transform
unit_z_5 = UnitZ(Factor=subtraction_2)
key_value_search_3 = KeyValueSearch(Keys=ghpython_script_10.keys_out, Values=ghpython_script_10.values_out, Search="Z_MAX_VOL")  # -> flatten(Result)
key_value_search_4 = KeyValueSearch(Keys=ghpython_script_10.keys_out, Values=ghpython_script_10.values_out, Search="Z_MIN_VOL")  # -> flatten(Result)
import_image = ImportImage(File=ghpython_script_11.tmrt_image)
extrude = Extrude(Base=ghpython_script_5.geo_out, Direction=unit_z_3)
ghpython_script_13 = GhPythonScript(curves=ghpython_script_5.geo_out, heights=key_value_search)  # -> out, flatten(geojson_str); inputs curves: list of Curve, heights: list
# ---------- ghpython_script_13: Python ----------
import json
import Rhino.Geometry as rg

def curve_to_coords(crv):
    if not crv.IsClosed:
        return []

    success, polyline = crv.TryGetPolyline()
    if not success:
        return []

    coords = [[pt.X, pt.Y] for pt in polyline]
    if coords[0] != coords[-1]:
        coords.append(coords[0])  # Ensure closure
    return [coords]  # GeoJSON requires a list of rings

# === Build GeoJSON ===
features = []

for i, crv in enumerate(curves):
    coords = curve_to_coords(crv)
    if not coords:
        continue
    height = float(heights[i]) if heights and i < len(heights) else 0.0
    feature = {
        "type": "Feature",
        "geometry": {
            "type": "Polygon",
            "coordinates": coords
        },
        "properties": {
            "height": height
        }
    }
    features.append(feature)

geojson_obj = {
    "type": "FeatureCollection",
    "features": features
}

geojson_str = json.dumps(geojson_obj, indent=2)
a = geojson_str  # Output for Hops
# ---------- end ghpython_script_13 ----------
ghpython_script_14 = GhPythonScript(curves=curve, heights="24")  # -> out, geojson_str; inputs curves: list of Curve, heights: list; same code as ghpython_script_13
unit_z_6 = UnitZ(Factor=key_value_search)
epw_stat = Ladybug_OpenEPWAndSTATWeatherFiles(weatherFileURL=panel_5)  # -> epwFile, statFile; plug-in component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
unit_z_7 = UnitZ(Factor="24")
unit_z_8 = UnitZ(Factor=key_value_search)
ghpython_script_15 = GhPythonScript(curve=ghpython_script_7.geo_out)  # -> out, flatten(a); inputs curve: Curve
# ---------- ghpython_script_15: Python ----------
import json
import Rhino.Geometry as rg

def curve_to_geojson_polygon(crv):
    if not crv.IsClosed:
        return None

    success, poly = crv.TryGetPolyline()
    if not success:
        return None

    coords = [[pt.X, pt.Y] for pt in poly]
    if coords[0] != coords[-1]:
        coords.append(coords[0])  # Ensure closed loop

    geojson = {
        "type": "Feature",
        "geometry": {
            "type": "Polygon",
            "coordinates": [coords]
        },
        "properties": {}
    }
    return json.dumps(geojson, indent=2)

# Run conversion
a = curve_to_geojson_polygon(curve)
# ---------- end ghpython_script_15 ----------
extrude_2 = Extrude(Base=move.Geometry, Direction=unit_z_4)  # -> flatten(Extrusion)
extrude_3 = Extrude(Base=polygon_3.Polygon, Direction=unit_z_4)  # -> flatten(Extrusion)
ghpython_script_16 = GhPythonScript(curves=ghpython_script_8.geo_out, tag="Pavement")  # -> out, a; inputs curves: list of Curve
# ---------- ghpython_script_16: Python ----------
import json
import Rhino.Geometry as rg

def curves_to_geojson_feature_collection(curves, tag="Green"):
    features = []

    for crv in curves:
        if not crv.IsClosed:
            continue  # Skip open curves

        success, poly = crv.TryGetPolyline()
        if not success:
            continue  # Skip non-polyline curves

        coords = [[pt.X, pt.Y] for pt in poly]
        if coords[0] != coords[-1]:
            coords.append(coords[0])  # Ensure closed loop

        feature = {
            "type": "Feature",
            "geometry": {
                "type": "Polygon",
                "coordinates": [coords]
            },
            "properties": {
                "features_type": tag
            }
        }
        features.append(feature)

    geojson = {
        "type": "FeatureCollection",
        "features": features
    }

    return json.dumps(geojson, indent=2)

# === Grasshopper input ===
# IN:
#   curves → List[Curve] (your Rhino closed polylines)
#   tag → string ("Green", "Pavement", etc.)

# OUT:
a = curves_to_geojson_feature_collection(curves, tag)
# ---------- end ghpython_script_16 ----------
curve_2 = Curve(ghpython_script_8.geo_out)
file_a = GhPythonScript(json_text_1=ghpython_script_4.a, json_text_2=ghpython_script_12.a)  # -> out, flatten(merged_output)
# ---------- file_a: Python ----------
import json

def parse_geojson(text):
    """
    Parse a raw GeoJSON string to Python dict.
    Returns None if input is empty or None.
    """
    if not text:
        return None
    try:
        return json.loads(text)
    except Exception as e:
        raise ValueError("Invalid JSON input:\n" + str(e))

# Example: Replace these with actual input strings
# json_text_1 = ...
# json_text_2 = ...

# Parse inputs (handle missing inputs)
geo1 = parse_geojson(json_text_1) if 'json_text_1' in locals() else None
geo2 = parse_geojson(json_text_2) if 'json_text_2' in locals() else None

# Extract features
features_1 = geo1.get("features", []) if geo1 else []
features_2 = geo2.get("features", []) if geo2 else []

# Merge into one FeatureCollection
merged = {
    "type": "FeatureCollection",
    "features": features_1 + features_2
}

# Output as raw JSON string
merged_output = json.dumps(merged, indent=2)
# ---------- end file_a ----------
subtraction_3 = Subtraction(A=key_value_search_3, B=key_value_search_4)
extrude_4 = Extrude(Base=move_2.Geometry, Direction=unit_z_5)  # -> flatten(Extrusion)
extrude_5 = Extrude(Base=polygon.Polygon, Direction=unit_z_5)  # -> flatten(Extrusion)
member_index = MemberIndex(Set=key_value_search_2, Member="Urban_Bloc")  # -> Index, Count
member_index_2 = MemberIndex(Set=key_value_search_2, Member="Public_Par")  # -> Index, Count
extrude_6 = Extrude(Base=ghpython_script_5.geo_out, Direction=unit_z_8)
extrude_7 = Extrude(Base=curve, Direction=unit_z_7)
cap_holes = CapHoles(Brep=extrude_2)  # -> flatten(Brep)
cap_holes_2 = CapHoles(Brep=extrude)
extrude_8 = Extrude(Base=ghpython_script_5.geo_out, Direction=unit_z_6)
file_a_2 = GhPythonScript(json_text_1=ghpython_script_14.geojson_str, json_text_2=ghpython_script_13.geojson_str)  # -> out, flatten(merged_output); same code as file_a
area = Area(Geometry=ghpython_script_7.geo_out)  # -> Area, Centroid
importlocation = Ladybug_ImportLocation(epwFile=epw_stat.epwFile)  # -> location; plug-in component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
unit_z_9 = UnitZ(Factor=subtraction_3)
cap_holes_3 = CapHoles(Brep=extrude_4)  # -> flatten(Brep)
list_item = ListItem(List=ghpython_script_9.geo_out, Index=member_index_2.Index, Wrap=True)
custom_preview_lineweights_2 = CustomPreviewLineweights(Geometry=list_item, Shader=ColourSwatch(SwatchColor=RGB(69, 87, 55)), Thickness=number_slider, Absolute=False)
list_item_2 = ListItem(List=ghpython_script_9.geo_out, Index=member_index.Index, Wrap=True)
mesh_2 = Mesh(list_item_2)
custom_preview_lineweights_3 = CustomPreviewLineweights(Geometry=list_item_2, Shader=ColourSwatch(SwatchColor=RGB(176, 176, 176)), Thickness=number_slider, Absolute=False)
area_2 = Area(Geometry=curve_2)  # -> Area, Centroid
series = Series(Start="1", Step=1, Count="24")
custom_preview = CustomPreview(Geometry=[cap_holes, extrude_3], Material=ColourSwatch(SwatchColor=RGB(129, 161, 98)))
cap_holes_4 = CapHoles(Brep=extrude_6)
cap_holes_5 = CapHoles(Brep=extrude_7)
cap_holes_6 = CapHoles(Brep=extrude_8)
custom_preview_2 = CustomPreview(Geometry=[cap_holes_3, extrude_5], Material=ColourSwatch(SwatchColor=RGB(196, 212, 180)))
extrude_9 = Extrude(Base=ghpython_script_10.geo_out, Direction=unit_z_9)
ghpython_script_17 = GhPythonScript(curves=list_item, tag="Green")  # -> out, flatten(a); inputs curves: list of Curve; same code as ghpython_script_16
ghpython_script_18 = GhPythonScript(curves=ghpython_script_8.geo_out, tag="Pavement")  # -> out, flatten(a); inputs curves: list of Curve; same code as ghpython_script_16
brep = Brep(ghpython_script_5.geo_out)
custom_preview_3 = CustomPreview(Geometry=cap_holes_2, Material=ColourSwatch(SwatchColor=RGB(161, 161, 161)))
custom_preview_4 = CustomPreview(Geometry=[cap_holes, extrude_3], Material=ColourSwatch(SwatchColor=RGB(129, 161, 98)))
sunpath = Ladybug_SunPath(location=importlocation, hour=series, day="3", month="8", timeStep=1, centerPt=area.Centroid, dailyOrAnnualSunPath=True)  # -> readMe, sunVectors, sunAltitudes, sunAzimuths, port, sunSpheresMesh, sunPathCrvs, compassCrvs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; plug-in component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
colour_swatch = ColourSwatch(SwatchColor=RGB(222, 0, 107))
custom_preview_lineweights_4 = CustomPreviewLineweights(Geometry=curve, Shader=colour_swatch, Thickness=Slider(2, range=0..10), Absolute=False)
custom_preview_5 = CustomPreview(Geometry=cap_holes_5, Material=colour_swatch)
dot_display = DotDisplay(Point=point, Colour=colour_swatch, Size=Slider(1, range=0..1))
custom_preview_6 = CustomPreview(Geometry=cap_holes_6, Material=ColourSwatch(SwatchColor=RGB(255, 255, 255)))
custom_preview_7 = CustomPreview(Geometry=brep, Material=ColourSwatch(SwatchColor=RGB(255, 255, 255)))
cap_holes_7 = CapHoles(Brep=extrude_9)
custom_preview_8 = CustomPreview(Geometry=mesh_2, Material=ColourSwatch(SwatchColor=RGB(201, 201, 201)))
custom_preview_9 = CustomPreview(Geometry=mesh, Material=ColourSwatch(SwatchColor=RGB(0, 130, 41)))
brep_wireframe = BrepWireframe(Brep=[cap_holes_6, cap_holes_5], Density=-1)  # disabled
merge_2 = Merge(Data1=cap_holes_5, Data2=cap_holes_6)
list_length = ListLength(List=sunpath.sunVectors)
colrange = LBColorRange(index="5")  # -> colors; plug-in component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
point_2 = Point(Point(0, 0, 0))
legendpar = Ladybug_LegendParameters(numSegments=list_length, customColors=flatten(colrange), legendLocation=point_2)  # -> legendPar; plug-in component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
merge_3 = Merge(Data1=cap_holes_5, Data2=cap_holes_6, Data3=cap_holes, Data4=cap_holes_3)  # -> flatten(Result)
brep_2 = Brep(ghpython_script_7.geo_out)
sunlighthoursanalysis = Ladybug_SunlightHoursAnalysis(
    geometry=flatten(brep_2),
    context=flatten(merge_3),
    gridSize="1",
    disFromBase="0.001",
    sunVectors=flatten(sunpath.sunVectors),
    timeStep=1,
    legendPar=flatten(legendpar),
    parallel=Toggle(True),
    runIt=Toggle(True))  # -> readMe, contextMesh, analysisMesh, testPts, testVec, port, sunlightHoursResult, sunlightHoursMesh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; plug-in component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
division_3 = Division(A=sunlighthoursanalysis.sunlightHoursResult, B=list_length)  # -> flatten(Result)
data_dam = DataDam(DataDataA=division_3, BufferDelay=10000000, BufferMode=0)
addition = Addition(A=division_3)
panel_6 = Panel("http://localhost:5000/full_svf_pipeline")
hops = Hops(
    Footprints=file_a_2.merged_output,
    Trees=file_a.merged_output,
    Extent=ghpython_script_15.a,
    PixelSize="1",
    PathFolder=panel,
    Green=ghpython_script_17.a,
    Pavement=ghpython_script_18.a,
    Shadows=division_3,
    CacheResultsInMemory=True,
    CacheSolveResults=True,
    RemoteDefinitionLocation="http://localhost:5000/full_pipeline",
    RemoteSolveVersion=(0, 1, 0),
    ShowInput_Enabled=False,
    ShowInput_Path=False,
    SynchronousSolve=True)  # -> Status, TmrtPNGPath, TmrtMatrixShadow
remap_numbers = RemapNumbers(Value=addition, Source="0.027 to 1", Target=Domain(0, 1))  # -> Mapped, Clipped
panel_7 = Panel(hops.Status)
ghpython_script_19 = GhPythonScript(x=hops.TmrtMatrixShadow, cell_size="1")  # -> out, mesh
# ---------- ghpython_script_19: Python ----------
import json
import Rhino.Geometry as rg
from System.Drawing import Color

# Define the spectral color gradient (cool → warm)
spectral = [
    (43, 131, 186),
    (171, 221, 164),
    (255, 255, 191),
    (253, 174, 97),
    (215, 25, 28)
    ]

# Fixed domain for value mapping
min_val = 20
max_val = 45

def remap(val, min_old, max_old, min_new, max_new):
    """Remap a value from one range to another."""
    if max_old - min_old == 0:
        return min_new
    return min_new + (val - min_old) * (max_new - min_new) / (max_old - min_old)

def clamp(val, min_v, max_v):
    """Clamp value to min/max range."""
    return max(min(val, max_v), min_v)

def lerp_color(c1, c2, t):
    """Linearly interpolate between two RGB tuples."""
    r = int(c1[0] + (c2[0] - c1[0]) * t)
    g = int(c1[1] + (c2[1] - c1[1]) * t)
    b = int(c1[2] + (c2[2] - c1[2]) * t)
    return Color.FromArgb(r, g, b)

def value_to_spectral_color(val, min_val, max_val):
    t = remap(val, min_val, max_val, 0.0, 1.0)
    t = clamp(t, 0.0, 1.0)

    n = len(spectral) - 1
    pos = t * n

    idx = int(pos)
    frac = pos - idx

    if idx >= n:
        return Color.FromArgb(*spectral[-1])
    c1 = spectral[idx]
    c2 = spectral[idx + 1]
    return lerp_color(c1, c2, frac)

# Initialize output
mesh = rg.Mesh()

try:
    matrix = json.loads(x)
    if not (isinstance(matrix, list) and isinstance(matrix[0], list)):
        raise ValueError("Invalid matrix format")

    rows = len(matrix)
    cols = len(matrix[0])

    # Add vertices and colors
    for i in range(rows):
        for j in range(cols):
            val = matrix[i][j]
            val_clamped = clamp(val, min_val, max_val)
            x_pos = j * cell_size
            y_pos = -i * cell_size
            pt = rg.Point3d(x_pos, y_pos, 0)
            mesh.Vertices.Add(pt)
            col = value_to_spectral_color(val_clamped, min_val, max_val)
            mesh.VertexColors.Add(col)

    # Add quad faces
    for i in range(rows - 1):
        for j in range(cols - 1):
            idx0 = i * cols + j
            idx1 = idx0 + 1
            idx2 = idx0 + cols
            idx3 = idx2 + 1
            mesh.Faces.AddFace(idx0, idx1, idx3, idx2)

    mesh.Normals.ComputeNormals()
    mesh.Compact()
    mesh.RebuildNormals()
    a = mesh

except Exception as e:
    a = "Error: " + str(e)
# ---------- end ghpython_script_19 ----------
area_3 = Area(Geometry=ghpython_script_19.mesh)  # -> Area, Centroid
vector_2pt = Vector2Pt(PointA=area_3.Centroid, PointB=area_2.Centroid, Unitize=False)  # -> Vector, Length
move_3 = Move(Geometry=ghpython_script_19.mesh, Motion=vector_2pt.Vector)  # -> Geometry, Transform
deconstruct_mesh = DeconstructMesh(Mesh=move_3.Geometry)  # -> Vertices, Faces, Colours, Normals
ghpython_script_20 = GhPythonScript(colors=deconstruct_mesh.Colours)  # -> out, a; inputs colors: list
# ---------- ghpython_script_20: Python ----------
from System.Drawing import Color

# Spectral color gradient (cool → warm), must match the coloring logic
spectral = [
    (94, 79, 162),   # purple-blue
    (50, 136, 189),  # blue
    (102, 194, 165), # teal
    (171, 221, 164), # light green
    (230, 245, 152), # yellow-green
    (254, 224, 139), # yellow
    (253, 174, 97),  # orange
    (244, 109, 67),  # red-orange
    (213, 62, 79),   # red
    (158, 1, 66)     # dark red
]

# Fixed scalar domain used for mapping
min_val = 15.0
max_val = 40.0

def lerp(c1, c2, t):
    """Linear interpolation between two RGB colors."""
    r = c1[0] + (c2[0] - c1[0]) * t
    g = c1[1] + (c2[1] - c1[1]) * t
    b = c1[2] + (c2[2] - c1[2]) * t
    return (int(r), int(g), int(b))

def color_distance(c1, c2):
    """Euclidean distance between two RGB colors."""
    return ((c1[0]-c2[0])**2 + (c1[1]-c2[1])**2 + (c1[2]-c2[2])**2)**0.5

def color_to_value(color):
    """Approximate scalar value from RGB color using Spectral gradient."""
    rgb = (color.R, color.G, color.B)
    n = len(spectral) - 1
    best_t = 0.0
    best_dist = float("inf")

    for i in range(n):
        for t in [j / 10.0 for j in range(11)]:  # finer interpolation
            c = lerp(spectral[i], spectral[i + 1], t)
            dist = color_distance(rgb, c)
            if dist < best_dist:
                best_dist = dist
                best_t = (i + t) / n

    value = min_val + best_t * (max_val - min_val)
    return value

# Recover all values from color list
try:
    recovered_values = [round(color_to_value(c), 2) for c in colors]
    a = recovered_values

    
except Exception as e:
    a = "Error: " + str(e)
# ---------- end ghpython_script_20 ----------
point_3 = Point(deconstruct_mesh.Vertices)
point_in_breps = PointInBreps(Brep=flatten(merge_2), Point=point_3, Strict=False)  # -> Inside, Index
dispatch = Dispatch(List=ghpython_script_20.a, DispatchPattern=point_in_breps.Inside)  # -> ListA, ListB
dispatch_2 = Dispatch(List=point_3, DispatchPattern=point_in_breps.Inside)  # -> ListA, ListB
point_4 = Point(dispatch_2.ListB)
text_tag_3d = TextTag3D(Location=point_4, Text=dispatch.ListB, Size=Slider(0.2, range=0..1), Justification=7)
panel_8 = Panel(dispatch.ListB)
area_4 = Area(Geometry=ghpython_script_7.geo_out)  # -> Area, Centroid
area_5 = Area(Geometry=ghpython_script_7.geo_out)  # -> Area, Centroid
point_5 = Point(Point(0, 0, 0))
point_6 = Point(Point(0, 0, 0))
vector_2pt_2 = Vector2Pt(PointA=area_4.Centroid, PointB=point_5, Unitize=False)  # -> Vector, Length
vector_2pt_3 = Vector2Pt(PointA=area_5.Centroid, PointB=point_6, Unitize=False)  # -> Vector, Length
move_4 = Move(Geometry=cap_holes, Motion=vector_2pt_3.Vector)  # -> Geometry, Transform
move_5 = Move(Geometry=move_3.Geometry, Motion=vector_2pt_2.Vector)  # -> Geometry, Transform
move_6 = Move(Geometry=cap_holes_6, Motion=vector_2pt_3.Vector)  # -> Geometry, Transform
move_7 = Move(Geometry=brep_wireframe, Motion=vector_2pt_3.Vector)  # -> Geometry, Transform
custom_preview_10 = CustomPreview(Geometry=move_4.Geometry, Material=ColourSwatch(SwatchColor=RGB(129, 161, 98)))
custom_preview_11 = CustomPreview(Geometry=move_6.Geometry, Material=ColourSwatch(SwatchColor=RGB(255, 255, 255)))
